# Grasshopper definition ui.gh (Grasshopper 1.0.8)
# plug-ins: jSwan

curve = Curve([<curve referenced from the Rhino model> x8])
read_file = ReadFile(File="C:\Dev\throughline-mep\output.json", PerLineParse=False)
deserialize_json = DeserializeJson(JSON=read_file, OutputsLocked=False)  # -> Object, FinishReason, Usage, Warnings, ProviderMetadata, Response, Request, Reasoning
area = Area(Geometry=curve)  # -> Area, Centroid
explode = Explode(Curve=curve, Recursive=True)  # -> Segments, Vertices
user_text = UserText(Content=curve, Keys="name", UserTextMode=1)  # -> Content, Keys, Values
guid = Guid(curve)
deconstruct = Deconstruct(Point=explode.Vertices)  # -> XComponent, YComponent, ZComponent
deserialize_json_2 = DeserializeJson(JSON=deserialize_json.Object, OutputsLocked=False)  # -> MainTrunk, Branches
serialize_json = SerializeJson(D1=deconstruct.XComponent, D2=deconstruct.YComponent, Data3=deconstruct.ZComponent, IncludeNullAndEmptyProperties=False)
text_tag = TextTag(Location=graft(area.Centroid), Text=user_text.Values)
panel = Panel(user_text.Values)
deserialize_json_3 = DeserializeJson(JSON=deserialize_json_2.Branches, OutputsLocked=False)  # -> RoomId, Points
deserialize_json_4 = DeserializeJson(JSON=deserialize_json_2.MainTrunk, OutputsLocked=False)
serialize_json_2 = SerializeJson(Data1=serialize_json, IncludeNullAndEmptyProperties=False)
panel_2 = Panel(serialize_json)
evaluate_text_fields = EvaluateTextFields()  # -> Text, Values
deserialize_json_5 = DeserializeJson(JSON=deserialize_json_3.Points, OutputsLocked=False)  # -> X, Y, Z
deserialize_json_6 = DeserializeJson(JSON=deserialize_json_4, OutputsLocked=False)  # -> X, Y, Z
serialize_json_3 = SerializeJson(
    Data1=guid,
    Name=user_text.Values,
    Area=graft(area.Area),
    Height=Slider(3, range=0..10),
    Geometry=serialize_json_2,
    IncludeNullAndEmptyProperties=False)  # -> flatten(JSON)
construct_point = ConstructPoint(XCoordinate=deserialize_json_5.X, YCoordinate=deserialize_json_5.Y, ZCoordinate=deserialize_json_5.Z)
construct_point_2 = ConstructPoint(XCoordinate=deserialize_json_6.X, YCoordinate=deserialize_json_6.Y, ZCoordinate=deserialize_json_6.Z)
serialize_json_4 = SerializeJson(Data1="test level", Rooms=serialize_json_3, IncludeNullAndEmptyProperties=False)
polyline = PolyLine(Vertices=construct_point, Closed=False)
polyline_2 = PolyLine(Vertices=construct_point_2, Closed=False)
panel_3 = Panel(serialize_json_4)
point_list = PointList(Points=construct_point_2, Size=Slider(1, range=0..100))
